# Grasshopper definition A-net.gh (Grasshopper 1.0.7)
# plug-ins: Weaverbird, GH_MinSurf, Bowerbird2, Pufferfish, MeshEdit Components, Heteroptera

# ---- group: side-crv
point = Point([Point(21.56542227, -9.821194506, 3), Point(21.57679548, -9.807706023, 4.383863636), Point(21.61091511, -9.767240576, 5.735454545), Point(21.66778116, -9.699798164, 7.054772727), Point(21.74739362, -9.605378786, 8.341818182), Point(21.84975251, -9.483982444, 9.596590909)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])
point_2 = Point([Point(21.56542227, 9.821194506, 3), Point(21.57679548, 9.807706023, 4.383863636), Point(21.61091511, 9.767240576, 5.735454545), Point(21.66778116, 9.699798164, 7.054772727), Point(21.74739362, 9.605378786, 8.341818182), Point(21.84975251, 9.483982444, 9.596590909)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])
unit_z = UnitZ(Factor=1)
list_item = ListItem(List=point_2, Index=0, Wrap=True)
list_item_2 = ListItem(List=point, Index=0, Wrap=True)
line_sdl = LineSDL(Start=list_item, Direction=unit_z, Length=1)
line_sdl_2 = LineSDL(Start=list_item_2, Direction=unit_z, Length=1)
rotate_axis = RotateAxis(Geometry=point, Angle="1*pi", Axis=line_sdl_2)  # -> Geometry, Transform
rotate_axis_2 = RotateAxis(Geometry=point_2, Angle="1*pi", Axis=line_sdl)  # -> Geometry, Transform
interpolate = Interpolate(Vertices=rotate_axis_2.Geometry, Degree=3, Periodic=False, KnotStyle=1)  # -> Curve, Length, Domain
interpolate_2 = Interpolate(Vertices=rotate_axis.Geometry, Degree=3, Periodic=False, KnotStyle=1)  # -> Curve, Length, Domain
xz_plane = XZPlane(Origin=list_item_2)
xz_plane_2 = XZPlane(Origin=list_item)
mirror = Mirror(Geometry=point, Plane=xz_plane)  # -> Geometry, Transform
mirror_2 = Mirror(Geometry=point_2, Plane=xz_plane_2)  # -> Geometry, Transform
interpolate_3 = Interpolate(Vertices=mirror_2.Geometry, Degree=3, Periodic=False, KnotStyle=1)  # -> Curve, Length, Domain
interpolate_4 = Interpolate(Vertices=mirror.Geometry, Degree=3, Periodic=False, KnotStyle=1)  # -> Curve, Length, Domain

# ----
minimal_surface_mesh = MinimalSurfaceMesh(UCount=20, VCount=20, Itteration=20)  # -> UVPointGrid, ResultingSurface
curve = Curve(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)
minimal_surface = MinimalSurface(UCount=20, VCount=20, Itteration=20, SurfaceUDegree=3, SurfaceVDegree=3)  # -> UVPointGrid, ResultingSurface

# ---- group: top(origin)
point_3 = Point([Point(26.1147061, 4.425801523, 24.54545455), Point(29.13306559, 3.918545562, 24.54545455), Point(31.46243745, 3.588457897, 24.54545455), Point(33.32850339, 3.388514567, 24.54545455), Point(34.91704942, 3.283001433, 24.54545455), Point(36.37396582, 3.247514182, 24.54545455)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])
interpolate_5 = Interpolate(Vertices=point_3, Degree=3, Periodic=False, KnotStyle=1)  # -> Curve, Length, Domain

# ----
xz_plane_3 = XZPlane(Origin=Point(0, 0, 0))
surface = Surface(<surface referenced from the Rhino model>)
geometry = Geometry(<brep referenced from the Rhino model>)
mirror_3 = Mirror(Geometry=geometry, Plane=xz_plane_3)  # -> Geometry, Transform
interpolate_6 = Interpolate(Vertices=point_2, Degree=3, Periodic=False, KnotStyle=1)  # -> Curve, Length, Domain

# ---- group: bottom
point_4 = Point([Point(21.56542227, 9.821194506, 3), Point(26.66691261, 10.23221738, 3), Point(30.84116829, 10.41924166, 3), Point(34.26673383, 10.43124852, 3), Point(37.09841416, 10.31023071, 3), Point(39.4672746, 10.09119264, 3)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])
interpolate_7 = Interpolate(Vertices=point_4, Degree=3, Periodic=False, KnotStyle=1)  # -> Curve, Length, Domain

# ----
number_slider = Slider(10, range=0..100)
interpolate_8 = Interpolate(Vertices=point, Degree=3, Periodic=False, KnotStyle=1)  # -> Curve, Length, Domain

# ---- group: top_crv
curve_2 = Curve(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)

# ----
number_slider_2 = Slider(30, range=0..100)
integer = Integer(Slider(20, range=0..100))
integer_2 = Integer(Slider(60, range=0..100))
mesh_surface = MeshSurface(Surface=surface, UCount=integer, VCount=integer_2, Overhang=True, Equalize=False)

# ---- group: uniscale-origin-b4
point_5 = Point([Point(-0.3631525048, -0.07173041822, 0.1745971939), Point(-0.3787123978, -0.09018425426, 0.1458696269), Point(-0.3923557511, -0.1063650983, 0.1147395526), Point(-0.4040261332, -0.1202060236, 0.08167596338), Point(-0.4136785019, -0.1316536106, 0.0471387139), Point(-0.4214002133, -0.1408114626, 0.01148143204), Point(-0.4273640421, -0.1478844879, -0.02501078775), Point(-0.431743946, -0.1530789985, -0.06205494044), Point(-0.4346994697, -0.1565842121, -0.09942485252), Point(-0.4363678168, -0.1585628506, -0.1369824394), Point(-0.4368842693, -0.1591753568, -0.1745971939)])

# ---- group: uniscale-origin-b3
point_6 = Point([Point(-0.3631525048, -0.07173041822, 0.1745971939), Point(-0.304458087, -0.06202166085, 0.1745971939), Point(-0.2454060434, -0.05484730873, 0.1745971939), Point(-0.1859793537, -0.05269542473, 0.1745971939), Point(-0.1266175695, -0.05632022925, 0.1745971939), Point(-0.06797793602, -0.06617243097, 0.1745971939)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])

# ---- group: uniscale-origin-b1
point_7 = Point([Point(-0.3631525048, 0.07173047276, 0.1745971939), Point(-0.3787123978, 0.0901843088, 0.1458696269), Point(-0.3923557511, 0.1063651529, 0.1147395526), Point(-0.4040261332, 0.1202060781, 0.08167596338), Point(-0.4136785019, 0.1316536651, 0.0471387139), Point(-0.4214002133, 0.1408115171, 0.01148143204), Point(-0.4273640421, 0.1478845424, -0.02501078775), Point(-0.431743946, 0.153079053, -0.06205494044), Point(-0.4346994697, 0.1565842666, -0.09942485252), Point(-0.4363678168, 0.1585629051, -0.1369824394), Point(-0.4368842693, 0.1591754113, -0.1745971939)])

# ---- group: uniscale-origin-b2
point_8 = Point([<point referenced from the Rhino model> x31])

# ----
mesh = Mesh(mesh_surface)
integer_3 = Integer(number_slider_2)
integer_4 = Integer(number_slider)

# ----
# 4 bddry crvs --> minimal mesh --> surface --> asymptotic directions
number_slider_3 = Slider(41, range=0..100)
number_slider_4 = Slider(21, range=0..100)
curve_3 = Curve([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])
curve_4 = Curve([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])
curve_5 = Curve([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])
curve_6 = Curve([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])
end_points = EndPoints(Curve=curve_5)  # -> Start, End
end_points_2 = EndPoints(Curve=curve_3)  # -> Start, End
end_points_3 = EndPoints(Curve=curve_4)  # -> Start, End
end_points_4 = EndPoints(Curve=curve_6)  # -> Start, End
list_item_3 = ListItem(List=end_points.Start, Index=0, Wrap=True)
list_item_4 = ListItem(List=end_points_2.Start, Index=0, Wrap=True)
list_item_5 = ListItem(List=end_points_3.Start, Index=0, Wrap=True)
list_item_6 = ListItem(List=end_points_4.Start, Index=0, Wrap=True)
merge = Merge(Data1=list_item_3, Data2=end_points.End)
merge_2 = Merge(Data1=list_item_4, Data2=end_points_2.End)
merge_3 = Merge(Data1=list_item_5, Data2=end_points_3.End)
merge_4 = Merge(Data1=list_item_6, Data2=end_points_4.End)
interpolate_9 = Interpolate(Vertices=merge_4, Degree=3, Periodic=False, KnotStyle=1)  # -> Curve, Length, Domain
interpolate_10 = Interpolate(Vertices=merge_2, Degree=3, Periodic=False, KnotStyle=1)  # -> Curve, Length, Domain
interpolate_11 = Interpolate(Vertices=merge, Degree=3, Periodic=False, KnotStyle=1)  # -> Curve, Length, Domain
interpolate_12 = Interpolate(Vertices=merge_3, Degree=3, Periodic=False, KnotStyle=1)  # -> Curve, Length, Domain
number_slider_5 = Slider(50, range=0..100)
minimal_surface_mesh_2 = MinimalSurfaceMesh(
    U0Curve=interpolate_11.Curve,
    U1Curve=interpolate_12.Curve,
    V0Curve=interpolate_9.Curve,
    V1Curve=interpolate_10.Curve,
    UCount=number_slider_3,
    VCount=number_slider_4,
    Itteration=Slider(1000, range=0..1000))  # -> flatten(UVPointGrid), ResultingMesh
addition = Addition(A=number_slider_4, B=1)
mesh_2 = Mesh(minimal_surface_mesh_2.ResultingMesh)
surface_from_points = SurfaceFromPoints(Points=minimal_surface_mesh_2.UVPointGrid, UCount=addition, Interpolate=False)
weaverbird_s_face_polylines = WeaverbirdsFacePolylines(Mesh=mesh_2)

# ---- group: AAGG
curve_7 = Curve([interpolate_11.Curve, interpolate_12.Curve])
curve_8 = Curve([interpolate_10.Curve, interpolate_9.Curve])
network_surface = NetworkSurface(CurvesU=curve_7, CurvesV=curve_8, Continuity=2)

# ----
number_slider_6 = Slider(2, range=0..10)
list_length = ListLength(List=merge)
list_length_2 = ListLength(List=merge_2)
division = Division(A=list_length, B=number_slider_6)
division_2 = Division(A=list_length_2, B=number_slider_6)
x_minus_one = XMinusOne(NumberX=division_2)
x_minus_one_2 = XMinusOne(NumberX=division)

x_plus_one = XPlusOne(NumberX=division_2)
x_plus_one_2 = XPlusOne(NumberX=division)

# ---- group: AAGG
curve_9 = Curve([interpolate_8.Curve, interpolate_6.Curve])
curve_10 = Curve([interpolate_5.Curve, interpolate_7.Curve])
network_surface_2 = NetworkSurface(CurvesU=curve_10, CurvesV=curve_9, Continuity=2)

# ----
number_slider_7 = Slider(100, range=0..100)

point_9 = Point([Point(-0.3417097957, 0.2322615215, 0.1642142917), Point(-0.2975941553, 0.1914589965, 0.1642142917), Point(-0.2523717534, 0.1518914422, 0.1642142917), Point(-0.2049901553, 0.1149547463, 0.1642142917), Point(-0.1539031755, 0.08341628362, 0.1642142917), Point(-0.09758545882, 0.06297766759, 0.1642142917)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])
point_10 = Point([Point(-0.4112034193, -0.1497095822, -0.1642142917), Point(-0.4107071416, -0.1502981613, -0.128818876), Point(-0.4091388986, -0.1521580776, -0.0934995207), Point(-0.4063670774, -0.1554454225, -0.05835957264), Point(-0.4022481577, -0.160330409, -0.02354021249), Point(-0.396630537, -0.166992836, 0.01076955745), Point(-0.3893640375, -0.1756108123, 0.04432404289), Point(-0.3803153833, -0.1863424016, 0.07681689892), Point(-0.3693895962, -0.1993002466, 0.1078879553), Point(-0.3565538647, -0.2145232616, 0.1371467619), Point(-0.3417097957, -0.2322615215, 0.1642142917)])
point_11 = Point([Point(-0.4112034193, 0.1497095822, -0.1642142917), Point(-0.3701211154, 0.1533900486, -0.1642142917), Point(-0.3289732321, 0.1562474146, -0.1642142917), Point(-0.2877761934, 0.1582704326, -0.1642142917), Point(-0.2465404961, 0.1591917159, -0.1642142917), Point(-0.2052984791, 0.1586915351, -0.1642142917)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])
point_12 = Point([Point(-0.4112034193, 0.1497095822, -0.1642142917), Point(-0.4107071416, 0.1502981613, -0.128818876), Point(-0.4091388986, 0.1521580776, -0.0934995207), Point(-0.4063670774, 0.1554454225, -0.05835957264), Point(-0.4022481577, 0.160330409, -0.02354021249), Point(-0.396630537, 0.166992836, 0.01076955745), Point(-0.3893640375, 0.1756108123, 0.04432404289), Point(-0.3803153833, 0.1863424016, 0.07681689892), Point(-0.3693895962, 0.1993002466, 0.1078879553), Point(-0.3565538647, 0.2145232616, 0.1371467619), Point(-0.3417097957, 0.2322615215, 0.1642142917)])

minimal_surface_mesh_3 = MinimalSurfaceMesh(
    U0Curve=interpolate_7.Curve,
    U1Curve=interpolate_5.Curve,
    V0Curve=interpolate_3.Curve,
    V1Curve=interpolate_4.Curve,
    UCount=number_slider_2,
    VCount=number_slider,
    Itteration=Slider(24, range=0..100))  # -> flatten(UVPointGrid), ResultingMesh
addition_2 = Addition(A=integer_4, B=1)
addition_3 = Addition(A=integer_3, B=1)
interpolate_13 = Interpolate(Vertices=point_6, Degree=3, Periodic=False, KnotStyle=1)  # -> Curve, Length, Domain
interpolate_14 = Interpolate(Vertices=point_8, Degree=3, Periodic=False, KnotStyle=1)  # -> Curve, Length, Domain
interpolate_15 = Interpolate(Vertices=point_5, Degree=3, Periodic=False, KnotStyle=1)  # -> Curve, Length, Domain
interpolate_16 = Interpolate(Vertices=point_7, Degree=3, Periodic=False, KnotStyle=1)  # -> Curve, Length, Domain
mesh_3 = Mesh(minimal_surface_mesh_3.ResultingMesh)
sdivide = DivideSurface(Surface=network_surface_2, UCount=integer_3, VCount=integer_4)  # -> Points, Normals, Parameters
center = Center(Geometric=interpolate_16.Curve)  # -> Center, Dimension
center_2 = Center(Geometric=interpolate_13.Curve)  # -> Center, Dimension
planar = Planar(Curve=interpolate_16.Curve)  # -> Planar, Plane, Deviation
planar_2 = Planar(Curve=interpolate_14.Curve)  # -> Planar, Plane, Deviation
planar_3 = Planar(Curve=interpolate_13.Curve)  # -> Planar, Plane, Deviation
planar_4 = Planar(Curve=interpolate_15.Curve)  # -> Planar, Plane, Deviation
center_3 = Center(Geometric=interpolate_14.Curve)  # -> Center, Dimension
center_4 = Center(Geometric=interpolate_15.Curve)  # -> Center, Dimension
mesh_frompoints = MeshFromPoints(Points=flatten(sdivide.Points), UDirection=addition_3, VDirection=addition_2)
cluster = Cluster(geometry=mesh_frompoints)
mesh_4 = Mesh(cluster)
panel = Panel(planar_2.Plane)
surface_from_points_2 = SurfaceFromPoints(Points=minimal_surface_mesh_3.UVPointGrid, UCount=addition_2, Interpolate=False)
weaverbird_s_face_polylines_2 = WeaverbirdsFacePolylines(Mesh=mesh_3)
panel_2 = Panel(planar_3.Plane)
panel_3 = Panel(planar_4.Plane)
panel_4 = Panel(planar.Plane)
panel_5 = Panel(center.Center)
panel_6 = Panel(center_2.Center)
panel_7 = Panel(center_3.Center)
panel_8 = Panel(center_4.Center)
weaverbird_s_face_polylines_3 = WeaverbirdsFacePolylines(Mesh=mesh_frompoints)

# ---- group: GAA5_sparse
mesh_5 = Mesh(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)  # disabled

# ----
deconstruct_mesh = DeconstructMesh(Mesh=mesh_4)  # -> Vertices, Faces, Colours, Normals

# ---- group: GAA5
mesh_6 = Mesh(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)  # disabled

# ----
integer_5 = Integer(integer_4)
integer_6 = Integer(integer_3)
brep = Brep(surface_from_points_2)
sdivide_2 = DivideSurface(Surface=brep, UCount=integer_5, VCount=integer_6)  # -> Points, Normals, Parameters
point_13 = Point(sdivide_2.Points)

deconstruct = Deconstruct()  # -> XComponent, YComponent, ZComponent

# ----
# extract 2 boundaries' points
flip = FlipMatrix(Data=point_13)
item = ListItem(List=flip, Index="-1", Wrap=True)  # -> simplify(flatten(Item))
intcrv = Interpolate(Vertices=item, Degree=3, Periodic=False, KnotStyle=1)  # -> Curve, Length, Domain
divide = DivideCurve(Curve=intcrv.Curve, Count=integer_6, Kinks=False)  # -> Points, Tangents, Parameters
srf_cp = SurfaceClosestPoint(Point=divide.Points, Surface=brep)  # -> Point, UVPoint, Distance

item_2 = ListItem(List=point_13, Index="-1", Wrap=True)  # -> simplify(flatten(Item))
intcrv_2 = Interpolate(Vertices=item_2, Degree=3, Periodic=False, KnotStyle=1)  # -> Curve, Length, Domain
divide_2 = DivideCurve(Curve=intcrv_2.Curve, Count=integer_5, Kinks=False)  # -> Points, Tangents, Parameters
srf_cp_2 = SurfaceClosestPoint(Point=divide_2.Points, Surface=brep)  # -> Point, UVPoint, Distance

# ---- group: 1. choose path type
bbκn = BBNormalCurvaturePath(Value=0, Angle=0, Direction=3)

# ---- group: 4. run pathfinder
bbpathfinder = BBPathfinder(
    PathType=bbκn,
    Surface=brep,
    StartPoint=[srf_cp.Point, srf_cp_2.Point],
    StepSize=0.1,
    MaximumNumberOfPoints=10000,
    StartPointType=0)  # -> simplify(Paths)

# ---- group: 1. choose path type
bbκn_2 = BBNormalCurvaturePath(Value=0, Angle=0, Direction=3)  # disabled

# ----
# evalue normal curvature at selected asymptote
item_3 = ListItem(List=flatten(bbpathfinder), Index=0, Wrap=True)
range = Range(Domain=Domain(0, 1), Steps=integer_6)
κn = BBNormalCurvatureCurveOnSurface(CurveOnSurface=reparameterize(item_3), Parameter=range)  # -> Point, simplify(flatten(Curvature)), OsculatingCircle
vlen = VectorLength(Vector=κn.Curvature)
bnd = Bounds(Numbers=vlen)
panel_9 = Panel(bnd)

number_slider_8 = Slider(2, range=0..10)  # disabled

surface_2 = Surface(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)  # disabled
number_slider_9 = Slider(41, range=0..100)  # disabled
number_slider_10 = Slider(21, range=0..100)  # disabled
number_slider_11 = Slider(1000, range=0..1000)  # disabled
number_slider_12 = Slider(100, range=0..100)  # disabled
number_slider_13 = Slider(100000, range=0..100000)  # disabled
number_slider_14 = Slider(0.015934, range=0..0.1)  # disabled
expression = Expression(Expression="1/0.015934")  # disabled
scale = Scale(Geometry=mesh_5, Center=Point(0, 0, 0), Factor=expression)  # -> Geometry, Transform; disabled
mesh_7 = Mesh(scale.Geometry)  # disabled

# ----
# 4 bddry crvs --> minimal mesh --> surface --> asymptotic directions
number_slider_15 = Slider(41, range=0..100)  # disabled
number_slider_16 = Slider(21, range=0..100)  # disabled
curve_11 = Curve([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])  # disabled
curve_12 = Curve([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])  # disabled
curve_13 = Curve([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])  # disabled
curve_14 = Curve([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])  # disabled
end_points_5 = EndPoints(Curve=curve_13)  # -> Start, End; disabled
end_points_6 = EndPoints(Curve=curve_11)  # -> Start, End; disabled
end_points_7 = EndPoints(Curve=curve_12)  # -> Start, End; disabled
end_points_8 = EndPoints(Curve=curve_14)  # -> Start, End; disabled
list_item_7 = ListItem(List=end_points_5.Start, Index=0, Wrap=True)  # disabled
list_item_8 = ListItem(List=end_points_6.Start, Index=0, Wrap=True)  # disabled
list_item_9 = ListItem(List=end_points_7.Start, Index=0, Wrap=True)  # disabled
list_item_10 = ListItem(List=end_points_8.Start, Index=0, Wrap=True)  # disabled
merge_5 = Merge(Data1=list_item_7, Data2=end_points_5.End)  # disabled
merge_6 = Merge(Data1=list_item_8, Data2=end_points_6.End)  # disabled
merge_7 = Merge(Data1=list_item_9, Data2=end_points_7.End)  # disabled
merge_8 = Merge(Data1=list_item_10, Data2=end_points_8.End)  # disabled
interpolate_17 = Interpolate(Vertices=merge_8, Degree=3, Periodic=False, KnotStyle=1)  # -> Curve, Length, Domain; disabled
interpolate_18 = Interpolate(Vertices=merge_6, Degree=3, Periodic=False, KnotStyle=1)  # -> Curve, Length, Domain; disabled
interpolate_19 = Interpolate(Vertices=merge_5, Degree=3, Periodic=False, KnotStyle=1)  # -> Curve, Length, Domain; disabled
interpolate_20 = Interpolate(Vertices=merge_7, Degree=3, Periodic=False, KnotStyle=1)  # -> Curve, Length, Domain; disabled
number_slider_17 = Slider(50, range=0..100)  # disabled
minimal_surface_mesh_4 = MinimalSurfaceMesh(
    U0Curve=interpolate_19.Curve,
    U1Curve=interpolate_20.Curve,
    V0Curve=interpolate_17.Curve,
    V1Curve=interpolate_18.Curve,
    UCount=number_slider_15,
    VCount=number_slider_16,
    Itteration=number_slider_11)  # -> flatten(UVPointGrid), ResultingMesh; disabled
addition_4 = Addition(A=number_slider_16, B=1)  # disabled
mesh_8 = Mesh(minimal_surface_mesh_4.ResultingMesh)  # disabled
weaverbird_s_face_polylines_4 = WeaverbirdsFacePolylines(Mesh=mesh_8)  # disabled
surface_from_points_3 = SurfaceFromPoints(Points=minimal_surface_mesh_4.UVPointGrid, UCount=addition_4, Interpolate=False)  # disabled

list_length_3 = ListLength(List=merge_5)  # disabled
list_length_4 = ListLength(List=merge_6)  # disabled
division_3 = Division(A=list_length_3, B=number_slider_8)  # disabled
division_4 = Division(A=list_length_4, B=number_slider_8)  # disabled
x_minus_one_3 = XMinusOne(NumberX=division_4)  # disabled
x_minus_one_4 = XMinusOne(NumberX=division_3)  # disabled

x_plus_one_3 = XPlusOne(NumberX=division_4)  # disabled
x_plus_one_4 = XPlusOne(NumberX=division_3)  # disabled
integer_7 = Integer(x_minus_one_3)  # disabled
integer_8 = Integer(x_minus_one_4)  # disabled
mesh_surface_2 = MeshSurface(Surface=surface_2, UCount=integer_7, VCount=integer_8, Overhang=True, Equalize=False)  # disabled
cluster_2 = Cluster(geometry=mesh_surface_2)  # disabled
mesh_9 = Mesh(cluster_2)  # disabled
weaverbird_s_face_polylines_5 = WeaverbirdsFacePolylines(Mesh=mesh_9)  # disabled
cluster_3 = Cluster(geometry=mesh_8)  # disabled
mesh_10 = Mesh(cluster_3)  # disabled

# ---- group: unitilize
cluster_4 = Cluster(geometry=surface_2)  # disabled

# ---- group: AAGG
curve_15 = Curve([interpolate_19.Curve, interpolate_20.Curve])  # disabled
curve_16 = Curve([interpolate_18.Curve, interpolate_17.Curve])  # disabled
network_surface_3 = NetworkSurface(CurvesU=curve_15, CurvesV=curve_16, Continuity=2)  # disabled

# ----
brep_2 = Brep(surface_from_points_3)  # disabled
integer_9 = Integer(number_slider_15)  # disabled
integer_10 = Integer(number_slider_16)  # disabled
sdivide_3 = DivideSurface(Surface=brep_2, UCount=integer_9, VCount=integer_10)  # -> Points, Normals, Parameters; disabled
point_14 = Point(sdivide_3.Points)  # disabled
panel_10 = Panel("-1")  # disabled

# ----
# extract 2 boundaries' points
flip_2 = FlipMatrix(Data=point_14)  # disabled
item_4 = ListItem(List=flip_2, Index=panel_10, Wrap=True)  # -> simplify(flatten(Item)); disabled
intcrv_3 = Interpolate(Vertices=item_4, Degree=3, Periodic=False, KnotStyle=1)  # -> Curve, Length, Domain; disabled
divide_3 = DivideCurve(Curve=intcrv_3.Curve, Count=integer_9, Kinks=False)  # -> Points, Tangents, Parameters; disabled
srf_cp_3 = SurfaceClosestPoint(Point=divide_3.Points, Surface=brep_2)  # -> Point, UVPoint, Distance; disabled

item_5 = ListItem(List=point_14, Index=panel_10, Wrap=True)  # -> simplify(flatten(Item)); disabled
intcrv_4 = Interpolate(Vertices=item_5, Degree=3, Periodic=False, KnotStyle=1)  # -> Curve, Length, Domain; disabled
divide_4 = DivideCurve(Curve=intcrv_4.Curve, Count=integer_10, Kinks=False)  # -> Points, Tangents, Parameters; disabled
srf_cp_4 = SurfaceClosestPoint(Point=divide_4.Points, Surface=brep_2)  # -> Point, UVPoint, Distance; disabled

# ---- group: 4. run pathfinder
bbpathfinder_2 = BBPathfinder(
    PathType=bbκn_2,
    Surface=brep_2,
    StartPoint=[srf_cp_3.Point, srf_cp_4.Point],
    StepSize=0.1,
    MaximumNumberOfPoints=10000,
    StartPointType=0)  # -> simplify(Paths); disabled

# ----
# evalue normal curvature at selected asymptote
item_6 = ListItem(List=flatten(bbpathfinder_2), Index=0, Wrap=True)  # disabled
range_2 = Range(Domain=Domain(0, 1), Steps=integer_9)  # disabled
κn_2 = BBNormalCurvatureCurveOnSurface(CurveOnSurface=reparameterize(item_6), Parameter=range_2)  # -> Point, simplify(flatten(Curvature)), OsculatingCircle; disabled
vlen_2 = VectorLength(Vector=κn_2.Curvature)  # disabled
bnd_2 = Bounds(Numbers=vlen_2)  # disabled
panel_11 = Panel(bnd_2)  # disabled

# ----
# asymptotic vectors
number_slider_18 = Slider(0.08, range=0..0.1)
number_slider_19 = Slider(1, range=0..1)
number_slider_20 = Slider(0.1, range=0..0.1)
bb_curvature_field = BBCurvatureField(PathType=bbκn, Surface=brep, Distance=Slider(2, range=0..10), Scale=Slider(1, range=0..10), Space=0)  # -> FirstDirections, SecondDirections

# ---- group: Plot
geometry_2 = Geometry(bb_curvature_field.FirstDirections)
geometry_3 = Geometry(bb_curvature_field.SecondDirections)

# ----
pipe = Pipe(Curve=geometry_2, Radius=number_slider_18, Caps=0)
pipe_2 = Pipe(Curve=geometry_3, Radius=number_slider_18, Caps=0)

# ----
# asymptotic vectors
number_slider_21 = Slider(0.08, range=0..0.1)  # disabled
number_slider_22 = Slider(1, range=0..1)  # disabled
number_slider_23 = Slider(0.1, range=0..0.1)  # disabled
number_slider_24 = Slider(1, range=0..10)  # disabled
number_slider_25 = Slider(2, range=0..10)  # disabled
bb_curvature_field_2 = BBCurvatureField(PathType=bbκn_2, Surface=brep_2, Distance=number_slider_25, Scale=number_slider_24, Space=0)  # -> FirstDirections, SecondDirections; disabled

# ---- group: Plot
geometry_4 = Geometry(bb_curvature_field_2.FirstDirections)  # disabled
geometry_5 = Geometry(bb_curvature_field_2.SecondDirections)  # disabled

# ----
pipe_3 = Pipe(Curve=geometry_4, Radius=number_slider_21, Caps=0)  # disabled
pipe_4 = Pipe(Curve=geometry_5, Radius=number_slider_21, Caps=0)  # disabled

# ==== cluster Cluster
geometry = ClusterInput()

# ----
# scale input surface into unit-diameter
geometry_2 = Geometry(geometry)
bounding_box = BoundingBox(Content=geometry_2, Plane=PlaneXY(0, 0, 0))  # -> Box, Box_2
box_properties = BoxProperties(Box=bounding_box.Box)  # -> Center, Diagonal, Area, Volume, Degeneracy
scale = Scale(Geometry=geometry_2, Center=box_properties.Center, Factor=expr("1/x", box_properties.Diagonal))  # -> Geometry, Transform
move = Move(Geometry=scale.Geometry, Motion=expr("-x", box_properties.Center))  # -> Geometry, Transform

geometry_3 = ClusterOutput(move.Geometry)
