# Grasshopper definition hops_hui.gh (Grasshopper 1.0.7)
# plug-ins: Weaverbird, Hops, Lionfish, NGon, LunchBox, Bowerbird2, MeshEdit Components

# ---- group: 1st or 2nd poly
number_slider = Slider(0, range=0..1)  # disabled

# ----
a_net_diag = BooleanToggle(False)  # disabled
a_net = BooleanToggle(False)  # disabled

g_net_diag = BooleanToggle(False)  # disabled
g_net = BooleanToggle(False)  # disabled

gga = BooleanToggle(False)  # disabled
agg = BooleanToggle(False)  # disabled

aag = BooleanToggle(False)  # disabled
gaa = BooleanToggle(False)  # disabled

aagg = BooleanToggle(False)  # disabled
ggaa = BooleanToggle(True)  # disabled

enneper = EnneperSurface(
    UDivisions=100,
    VDivisions=100,
    RParameter=Slider(4, range=0..10),
    Scale=15,
    Domain1=Domain(0, 1),
    Domain2=Domain(-3.141592654, 3.141592654))

helicoid = HelicoidSurface(
    UDivisions=100,
    VDivisions=100,
    RParameter=2,
    TParameter=1,
    Scale=Slider(1, range=0..1),
    Domain1=Domain(-6.283185307, 6.283185307),
    Domain2="-pi to pi")

# ----
# WW_spiral_minimal3
srf = Surface(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)

# ----
# WW_spiral_minimal1
srf_2 = Surface(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)

# ----
# WW_spiral_minimal2
srf_3 = Surface(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)

# ----
# Input Surface
lamella_surfaces = Surface([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])

# ----
# k1/k2=-1, -2, -4
surface = Surface(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)
surface_2 = Surface(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)
surface_3 = Surface(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)

# ---- group: rot_a_minus_1_crpc_uv_unitscale_half_cut_def_GAA
# GGA
mesh = Mesh(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)

# ---- group: rot_a_minus_2_crpc_uv_half_unitscale
# GAA
# AAG, GAA, AGG,GGA web,
# need to choose which geodesic/asympototic
mesh_2 = Mesh(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)

# ----
weaverbird_s_naked_boundary = WeaverbirdsNakedBoundary(MeshClosedPolylines=mesh_2)

# ---- group: a1gnet5_2g+voss+asy_unitscale
# Guided Projection Algorithm Settings
mesh_3 = Mesh(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)

# ---- group: a1gnet3_2g+voss+asy_unitscale
mesh_4 = Mesh(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)

# ---- group: butterfly_1_add_pq
# choose the Net / Web type
# Voss net = G-net + PQ
mesh_5 = Mesh(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)

# ---- group: boiler_suit_diaggnet_dmesh_patch2_unitscale_voss_join2_voss
mesh_6 = Mesh(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)

# ---- group: 1st or 2nd poly
number_slider_2 = Slider(1, range=0..1)

# ----
# scale input surface into unit-diameter
geometry = Geometry(surface)
bounding_box = BoundingBox(Content=geometry, Plane=PlaneXY(0, 0, 0))  # -> Box, Box_2
box_properties = BoxProperties(Box=bounding_box.Box)  # -> Center, Diagonal, Area, Volume, Degeneracy
scale = Scale(Geometry=geometry, Center=box_properties.Center, Factor=expr("1/x", box_properties.Diagonal))  # -> Geometry, Transform
move = Move(Geometry=scale.Geometry, Motion=expr("-x", box_properties.Center))  # -> Geometry, Transform

panel = Panel("AGG")
panel_2 = Panel("GGA")

panel_3 = Panel("GAA")

panel_4 = Panel("Anet")
panel_5 = Panel("AnetDiagnet")

# ---- group: a1gnet5_2g+voss+asy_join_2g+voss+asy_cut_unitscale
mesh_7 = Mesh(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)

# ---- group: rot_min1_spiral_cut_2g+voss+asy_unitscale_cut
mesh_8 = Mesh(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)

# ---- group: a1gnet2_2g+voss+asy_unitscale
# GGAA
mesh_9 = Mesh(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)

# ---- group: a1gnet6_unitscale
mesh_10 = Mesh(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)

# ---- group: helical_crpc_h0.05_angle120_cut_unitscale
# (diag)A-net
mesh_11 = Mesh(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)

# ---- group: Iterations
iter = Slider(10, range=5..20)

# ---- group: weight_fairness
fairness = Panel("0.001")
fairness_2 = Panel("0.005")
fairness_3 = Panel("0.0005")
number = Number(fairness)

# ---- group: weight_self-closeness
closness = Panel("0.01")
closness_2 = Panel("0")
number_2 = Number(closness)

# ---- group: eps
epsilon_default = Panel("0.001")
number_3 = Number(epsilon_default)

# ----
panel_6 = Panel("AAGG")
panel_7 = Panel("GGAA")

# ---- group: minimal_3noid_1_patch_unitscale
# AAGG
mesh_12 = Mesh(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)

# ----
panel_8 = Panel("Gnet")
panel_9 = Panel("GnetDiagnet")

# ----
# AAG (SINGULARITY)
# if the mesh with singularity
# G-net
singular = BooleanToggle(True)

# ---- group: gnet5_unitscale
mesh_13 = Mesh(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)

# ---- group: gnet3_unitscale_seam
mesh_14 = Mesh(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)

# ---- group: gridshell_6valence_aag_unitscale
# Inputs Mesh
mesh_15 = Mesh(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)

# ---- group: gridshell_8valence_aag_unitscale
mesh_16 = Mesh(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)

# ----
# Path
florian_s = Panel("http://10.68.74.6:5000/processMesh")
mine = Panel("http://127.0.0.1:5000/processMesh")
local = Panel("http://localhost:5000/read_a_mesh")

unitilize = Unitilize(mesh=mesh_16)
restart = BooleanToggle(True)
panel_10 = Panel("AAG")

# ---- group: Optimize
trigger = Trigger(Interval=-1000, TimerInterval=1000, Target=hops)

# ---- group: input quadmesh
mesh_17 = Mesh(unitilize)

# ---- group: is_singular
boolean = Boolean(singular)

# ---- group: fairness
number_4 = Number(number)

# ---- group: iteration
integer = Integer(iter)

# ---- group: self-closeness
number_5 = Number(number_2)

# ---- group: direction
integer_2 = Integer(number_slider_2)

# ---- group: 2. select surface
brep = Brep(move.Geometry)

# ----
# 提取曲面上边界点 （均匀的点）
number_slider_3 = Slider(20, range=0..100)
sdivide = DivideSurface(Surface=brep, UCount=number_slider_3, VCount=number_slider_3)  # -> Points, Normals, Parameters
flip = FlipMatrix(Data=sdivide.Points)
item = ListItem(List=flip, Index="-1", Wrap=True)  # -> simplify(flatten(Item))
intcrv = Interpolate(Vertices=item, Degree=3, Periodic=False, KnotStyle=1)  # -> Curve, Length, Domain
divide = DivideCurve(Curve=intcrv.Curve, Count=number_slider_3, Kinks=False)  # -> Points, Tangents, Parameters
srf_cp = SurfaceClosestPoint(Point=divide.Points, Surface=brep)  # -> Point, UVPoint, Distance

# ---- group: Surf-->Mesh
mesh_frompoints = MeshFromPoints(Points=flatten(sdivide.Points), UDirection=expr("x+1", number_slider_3), VDirection=expr("x+1", number_slider_3))

# ----
weaverbird_s_face_polylines = WeaverbirdsFacePolylines(Mesh=mesh_frompoints)

# ----
# Process
hops = Hops(
    _Path=local,
    Mesh=mesh_17,
    SingularRegular=boolean,
    Iteration=integer,
    Fairness=number_4,
    W2Closeness=number_5,
    Direction=integer_2,
    Web=panel_10,
    Restart=restart,
    CacheResultsInMemory=False,
    CacheSolveResults=False,
    RemoteDefinitionLocation="http://localhost:5000/read_a_mesh",
    RemoteSolveVersion=(0, 1, 0),
    ShowInput_Enabled=False,
    ShowInput_Path=True,
    SynchronousSolve=True)  # -> Mesh, Vertices, Normal

item_2 = ListItem(List=sdivide.Points, Index="-1", Wrap=True)  # -> simplify(flatten(Item))
intcrv_2 = Interpolate(Vertices=item_2, Degree=3, Periodic=False, KnotStyle=1)  # -> Curve, Length, Domain
divide_2 = DivideCurve(Curve=intcrv_2.Curve, Count=number_slider_3, Kinks=False)  # -> Points, Tangents, Parameters
srf_cp_2 = SurfaceClosestPoint(Point=divide_2.Points, Surface=brep)  # -> Point, UVPoint, Distance

# ---- group: output quadmesh
# Outputs
mesh_18 = Mesh(hops.Mesh)

# ---- group: vertices
point = Point(hops.Vertices)

# ---- group: normal
vector = Vector(hops.Normal)

# ---- group: 1. choose path type
bbκn = BBNormalCurvaturePath(Value=0, Angle=0, Direction=3)

# ----
# intersect points
bbpathfinder = BBPathfinder(PathType=bbκn, Surface=brep, StartPoint=srf_cp_2.Point, StepSize=0.1, MaximumNumberOfPoints=10000, StartPointType=0)
bbpathfinder_2 = BBPathfinder(PathType=bbκn, Surface=brep, StartPoint=srf_cp.Point, StepSize=0.1, MaximumNumberOfPoints=10000, StartPointType=0)
lng = ListLength(List=srf_cp.Point)
dom = ConstructDomain(DomainStart=expr("1", 0), DomainEnd=expr("x-1", lng))
item_3 = ListItem(List=bbpathfinder_2, Index=dom, Wrap=True)
deconstruct = BBDeconstructCurveOnSurface(CurveOnSurface=bbpathfinder)  # -> Surface, Curve, Approximation
deconstruct_2 = BBDeconstructCurveOnSurface(CurveOnSurface=item_3)  # -> Surface, Curve, Approximation
crv = Curve(reparameterize(flatten(deconstruct_2.Approximation)))
crv_2 = Curve(reparameterize(flatten(deconstruct.Approximation)))
ccx = CurveCurve(CurveA=graft(crv), CurveB=crv_2)  # -> simplify(flatten(Points)), simplify(flatten(ParamsA)), simplify(flatten(ParamsB))

# ---- group: 4. run pathfinder
bbpathfinder_3 = BBPathfinder(
    PathType=bbκn,
    Surface=brep,
    StartPoint=[srf_cp.Point, srf_cp_2.Point],
    StepSize=0.1,
    MaximumNumberOfPoints=10000,
    StartPointType=0)  # -> simplify(Paths)

# ----
# Optimized mesh vertex-normals
weaverbird_s_mesh_edges = WeaverbirdsMeshEdges(MeshOrPolylines=mesh_18)
# Visulization
length = Length(Curve=weaverbird_s_mesh_edges)
average = Average(Input=length)
amplitude = Amplitude(Vector=vector, Amplitude=average)
addition = Addition(A=point, B=amplitude)
line = Line(StartPoint=point, EndPoint=addition)

# ----
# get 2 ctrl-polylines + 2 diag-polylines
local_2 = Panel("http://localhost:5000/polyline_4_directions")
trigger_2 = Trigger(Interval=-1000, TimerInterval=1000, Target=hops_2)
hops_2 = Hops(
    _Path=local_2,
    Mesh=mesh_18,
    CacheResultsInMemory=False,
    CacheSolveResults=False,
    RemoteDefinitionLocation="http://localhost:5000/polyline_4_directions",
    RemoteSolveVersion=(0, 1, 0),
    ShowInput_Enabled=False,
    ShowInput_Path=True,
    SynchronousSolve=True)  # -> Polyline1, Polyline2, Polyline3, Polyline4

# ----
# if True, choose constraints on checker vertices;
# else, all inner vertices
checker_vertices = BooleanToggle(True)

# ---- group: ith-poly
# choose which polyline to plot:
# 1st, 2nd from control polylines
# 3rd, 4th from diagonal polylines
panel_11 = Panel("1")
panel_12 = Panel("2")
# choose fairness weight for control points of each Bezier spline
panel_13 = Panel("4")
integer_3 = Integer("3")

# ----
# get checker vertices
local_3 = Panel("http://localhost:5000/checker_tianvertex")
trigger_3 = Trigger(Interval=-1000, TimerInterval=1000, Target=hops_3)
hops_3 = Hops(
    _Path=local_3,
    Mesh=mesh_18,
    CacheResultsInMemory=False,
    CacheSolveResults=False,
    RemoteDefinitionLocation="http://localhost:5000/checker_tianvertex",
    RemoteSolveVersion=(0, 1, 0),
    ShowInput_Enabled=False,
    ShowInput_Path=True,
    SynchronousSolve=True)  # -> P1, P2
point_2 = Point(hops_3.P2)
point_3 = Point(hops_3.P1)

# ---- group: weight_fairness_Bezier-Ctrl-Pts
panel_14 = Panel("0.01")
panel_15 = Panel("0.05")
number_6 = Number("0.005")

# ---- group: width
panel_16 = Panel("0.5")

# ---- group: weight_fairness_strip
number_7 = Number("0.01")

# ---- group: dist_interval
panel_19 = Panel("1.5")

# ---- group: num_dense_ruling
panel_20 = Panel("20")

# ----
# if True, choose more denser ruling vectors
dense = BooleanToggle(True)
number_8 = Number(panel_20)

# ----
# if True, the rulings and strips are optimized result
# else, directly computed from r = \tau*t + k*E3
optruling = BooleanToggle(True)

# ----
# choose interval distance of unrolled strips
number_9 = Number(panel_19)

# ----
# choose width of strips
number_10 = Number(panel_16)

# ----
# get Beziersplines + Frenet frame + rulings + strips + unrollment
local_4 = Panel("http://localhost:5000/bezier_spline_strips")
hops_4 = Hops(
    _Path=local_4,
    Mesh=mesh_18,
    Web=panel_10,
    VN=vector,
    Ipoly=integer_3,
    W1CtrlPoint=number_6,
    W2Strip=number_7,
    NumDenser=number_8,
    Width=number_10,
    DistInterval=number_9,
    Checker=checker_vertices,
    DenseSparse=dense,
    OptRulingCmptRuling=optruling,
    SingularRegular=boolean,
    CacheResultsInMemory=False,
    CacheSolveResults=False,
    RemoteDefinitionLocation="http://localhost:5000/bezier_spline_strips",
    RemoteSolveVersion=(0, 1, 0),
    ShowInput_Enabled=False,
    ShowInput_Path=True,
    SynchronousSolve=True)  # -> CtrlP, Indices, Bezier, An, E1, E2, E3, R, Strip, UnrollStrip

# ----
# Run
trigger_4 = Trigger(Interval=-1000, TimerInterval=1000, Target=hops_4)

# ---- group: 4th-polyline
line_2 = Line(hops_2.Polyline4)

# ---- group: 1st-polyline
line_3 = Line(hops_2.Polyline1)

# ---- group: 3rd-polyline
line_4 = Line(hops_2.Polyline3)

# ---- group: 2nd-polyline
line_5 = Line(hops_2.Polyline2)

# ----
number_slider_4 = Slider(0.01, range=0..0.2)
number_slider_5 = Slider(0, range=0..0.1)
clean = CleanTree(RemoveNulls=True, RemoveInvalid=True, RemoveEmpty=False, Tree=flatten(item_3))
# unroll into plane
extrude = BBExtrudeCurveOnSurface(CurveOnSurface=clean, Thickness=number_slider_4, Offset=number_slider_5, Smooth=True, Unroll=True)
number_slider_6 = Slider(0.1, range=0..1)
srf_4 = Surface(extrude)
lng_2 = ListLength(List=srf_4)
series = Series(Start=0, Step=number_slider_6, Count=lng_2)
X = UnitX(Factor=series)
move_2 = Move(Geometry=srf_4, Motion=X)  # -> Geometry, Transform

clean_2 = CleanTree(RemoveNulls=True, RemoveInvalid=True, RemoveEmpty=False, Tree=flatten(bbpathfinder))
extrude_2 = BBExtrudeCurveOnSurface(CurveOnSurface=clean_2, Thickness=number_slider_4, Offset=number_slider_5, Smooth=True, Unroll=True)
srf_5 = Surface(extrude_2)
lng_3 = ListLength(List=srf_5)
series_2 = Series(Start=0, Step=number_slider_6, Count=lng_3)
X_2 = UnitX(Factor=series_2)
move_3 = Move(Geometry=srf_5, Motion=X_2)  # -> Geometry, Transform

# ---- group: v
point_4 = Point(hops_4.An)

# ---- group: allP
point_5 = Point(hops_4.CtrlP)

# ---- group: e1
vector_2 = Vector(hops_4.E1)

# ---- group: e3
vector_3 = Vector(hops_4.E3)

# ---- group: r
vector_4 = Vector(hops_4.R)

# ---- group: e2
vector_5 = Vector(hops_4.E2)

# ----
# unit principal normal E2
amplitude_2 = Amplitude(Vector=vector_5, Amplitude=average)
addition_2 = Addition(A=point_4, B=amplitude_2)
line_6 = Line(StartPoint=point_4, EndPoint=addition_2)

# ----
# unit Darboux(ruling) r
amplitude_3 = Amplitude(Vector=vector_4, Amplitude=average)
addition_3 = Addition(A=point_4, B=amplitude_3)
line_7 = Line(StartPoint=point_4, EndPoint=addition_3)

# ----
# unit binormal E3
amplitude_4 = Amplitude(Vector=vector_3, Amplitude=average)
addition_4 = Addition(A=point_4, B=amplitude_4)
line_8 = Line(StartPoint=point_4, EndPoint=addition_4)

# ----
# unit tangent E1
amplitude_5 = Amplitude(Vector=vector_2, Amplitude=average)
addition_5 = Addition(A=point_4, B=amplitude_5)
line_9 = Line(StartPoint=point_4, EndPoint=addition_5)

# ----
# get Splines
number_slider_7 = Slider(0.002, range=0..0.01)
curve = Curve(hops_4.Bezier)
pipe = Pipe(Curve=curve, Radius=number_slider_7, Caps=2)

# ----
# get lamellals
mesh_19 = Mesh(hops_4.Strip)
weaverbird_s_mesh_edges_2 = WeaverbirdsMeshEdges(MeshOrPolylines=mesh_19)

# ----
# get unrollment
mesh_20 = Mesh(hops_4.UnrollStrip)
weaverbird_s_mesh_edges_3 = WeaverbirdsMeshEdges(MeshOrPolylines=mesh_20)

# ---- group: unroll
srf_6 = Surface(move_2.Geometry)

srf_7 = Surface(move_3.Geometry)

# ----
# lamellal
extrude_3 = BBExtrudeCurveOnSurface(CurveOnSurface=clean, Thickness=number_slider_4, Offset=number_slider_5, Smooth=True, Unroll=False)
extrude_4 = BBExtrudeCurveOnSurface(CurveOnSurface=clean_2, Thickness=number_slider_4, Offset=number_slider_5, Smooth=True, Unroll=False)

# ---- group: unroll
merge = Merge(Data1=srf_6, Data2=srf_7)

# ----
merge_2 = Merge(Data1=extrude_3, Data2=extrude_4)

unit_x = UnitX(Factor=Slider(0.2, range=0..1))
colour_rgb = ColourRGB(Alpha=255, Red=0, Green=0, Blue=Slider(1, range=0..1))
move_4 = Move(Geometry=weaverbird_s_mesh_edges_3, Motion=unit_x)  # -> Geometry, Transform
custom_preview = CustomPreview(Geometry=[move_4.Geometry, weaverbird_s_mesh_edges_2], Material=colour_rgb)

# ----
# Validation
# check: geodesic between two vertices by <> way
naked_vertices = NakedVertices(Mesh=mesh_18)  # -> Vertices, Status
list_item = ListItem(List=naked_vertices.Vertices, Index="38", Wrap=True)
list_item_2 = ListItem(List=naked_vertices.Vertices, Index="73", Wrap=True)
geodesiccurves = GeodesicCurves(Mesh=mesh_18, StartPoint=list_item_2, EndPoint=list_item)

# ----
# reshape a list
list_length = ListLength()  # disabled
list_item_3 = ListItem(Index=0, Wrap=True)  # disabled
multiplication = Multiplication(A=list_item_3, B=list_length)  # disabled
series_3 = Series(Start=0, Step=1, Count=multiplication)  # disabled
partition_list = PartitionList(List=series_3, Size=list_item_3)  # -> simplify(Chunks); disabled

# ----
# control_points + Bezier_splines
list_item_4 = ListItem(List=point_5, Index=partition_list, Wrap=True)  # disabled
control_points = Point(list_item_4)  # disabled
panel_21 = Panel("5")  # disabled
nurbs_curve = NurbsCurve(Vertices=control_points, Degree=panel_21, Periodic=False)  # -> Curve, Length, Domain; disabled

# ----
# evalue normal curvature at selected asymptote
item_4 = ListItem(List=flatten(bbpathfinder_3), Index=0, Wrap=True)
range = Range(Domain=Domain(0, 1), Steps=number_slider_3)

# ---- group: 6. measure normal curvature
κn = BBNormalCurvatureCurveOnSurface(CurveOnSurface=reparameterize(item_4), Parameter=range)  # -> Point, simplify(flatten(Curvature)), OsculatingCircle

# ----
vlen = VectorLength(Vector=κn.Curvature)
bnd = Bounds(Numbers=vlen)
panel_22 = Panel(bnd)

# ==== cluster Unitilize
mesh = ClusterInput()
# scale input surface into unit-diameter
mesh_2 = Mesh(mesh)
bounding_box = BoundingBox(Content=mesh_2, Plane=PlaneXY(0, 0, 0))  # -> Box, Box_2
box_properties = BoxProperties(Box=bounding_box.Box)  # -> Center, Diagonal, Area, Volume, Degeneracy
scale = Scale(Geometry=mesh_2, Center=box_properties.Center, Factor=expr("1/x", box_properties.Diagonal))  # -> Geometry, Transform
move = Move(Geometry=scale.Geometry, Motion=expr("-x", box_properties.Center))  # -> Geometry, Transform
mesh_3 = Mesh(move.Geometry)
unitmesh = ClusterOutput(mesh_3)
